# Grasshopper definition LES LBM simulation geometry.gh (Grasshopper 1.0.8)

# VOXEL FIELD DISCRETIZTION
# FOR LATTICE-BOLTZMANN
# METHOD SIMULATION
number_slider = Slider(0, range=0..100)

# ----
# VOXEL ARRAY
#  PROPORTIONS
# X
# Y
# Z
number_slider_2 = Slider(10, range=0..100)

dom = ConstructDomain(DomainStart=number_slider, DomainEnd=number_slider_2)
dom_2 = ConstructDomain(DomainStart=number_slider, DomainEnd=Slider(8, range=0..100))
dom_3 = ConstructDomain(DomainStart=number_slider, DomainEnd=Slider(6, range=0..100))
box = DomainBox(Base=PlaneXY(0, 0, 0), X=dom, Y=dom_2, Z=dom_3)
boxprop = BoxProperties(Box=box)  # -> Center, Diagonal, Area, Volume, Degeneracy
total_field_volume = Panel(boxprop.Volume)
devec = DeconstructVector(Vector=boxprop.Diagonal)  # -> XComponent, YComponent, ZComponent
expression = Expression(x=devec.XComponent, Expression="ceiling(x)")
expression_2 = Expression(x=devec.YComponent, Expression="ceiling(x)")
expression_3 = Expression(x=devec.ZComponent, Expression="ceiling(x)")
expression_4 = Expression(x=devec.XComponent, y=expression, Expression="x/(2*y)")
expression_5 = Expression(x=devec.YComponent, y=expression_2, Expression="x/(2*y)")
expression_6 = Expression(x=devec.ZComponent, y=expression_3, Expression="x/(2*y)")
range = Range(Domain=Domain(0, 1), Steps=expression)
range_2 = Range(Domain=Domain(0, 1), Steps=expression_2)
range_3 = Range(Domain=Domain(0, 1), Steps=expression_3)
crossref = CrossReference(ListA=range, ListB=range_2, ListC=range_3, CrossMode=1)  # -> ListA, ListB, ListC

# ----
# VOXEL/MESH
# VERTEX RESOLUTION
number_slider_3 = Slider(1, range=0..10)

box_2 = CenterBox(Base=PlaneXY(0, 0, 0), X=expression_4, Y=expression_5, Z=expression_6)
box_3 = EvaluateBox(Box=box, UParameter=crossref.ListA, VParameter=crossref.ListB, WParameter=crossref.ListC)  # -> Plane, Point, Include
mbox = MeshBox(Base=box_2, XCount=number_slider_3, YCount=number_slider_3, ZCount=number_slider_3)
move = Move(Geometry=mbox, Motion=box_3.Point)  # -> Geometry, Transform

# ----
# SELECT VOXEL TO
# REPRESENT BUILDING
number_slider_4 = Slider(49, range=0..1000)

lng = ListLength(List=move.Geometry)  # -> flatten(Length)
voxel_count = Panel(lng)
item = ListItem(List=move.Geometry, Index=number_slider_4, Wrap=True)
cull_i = CullIndex(List=move.Geometry, Indices=number_slider_4, Wrap=True)

# ----
# VOXEL FIELD
mesh = Mesh(cull_i)
demesh = DeconstructMesh(Mesh=mesh)  # -> Vertices, Faces, Colours, Normals
volume = Volume(Geometry=mesh)  # -> Volume, Centroid
voxel_centroids = Panel(volume.Centroid)
# TO SAVE DATA, RIGHT CLICK AND
# SELECT STREAM DESTINATION.
# 
# SELECT FILE TYPE AS .XYZ OR .TXT
# 
# SOME PRE OR POST-FORMATTING
# OF VOXEL DATA MAY BE NECESSARY
# TO USE IN PYTHON SCRIPT
mesh_vertices = Panel(demesh.Vertices)
volumes = Panel(volume.Volume)

# ----
# VOXEL FOR BUILDING
mesh_2 = Mesh(item)
demesh_2 = DeconstructMesh(Mesh=mesh_2)  # -> Vertices, Faces, Colours, Normals
medges = MeshEdges(Mesh=mesh_2)  # -> NakedEdges, InteriorEdges, NonManifoldEdges
face = MeshFace(demesh_2.Faces)
mesh_vertices_2 = Panel(demesh_2.Vertices)
mesh_faces = Panel(face)
mesh_edges = Panel(medges.InteriorEdges)
