# Grasshopper definition mesh project.gh (Grasshopper 1.0.8)
# Copyright: ©2019 GNU General Public License
# plug-ins: Karamba3D, Pufferfish, CockroachGH, Kangaroo2 Components, Flexibility

# ----
# initial rectangle
number_slider = Slider(100, range=0..100)
rectangle = Rectangle(Plane=PlaneXY(0, 0, 0), XSize=number_slider, YSize=number_slider, Radius=0)  # -> Rectangle, Length
brep = Brep(rectangle.Rectangle)

# ----
# LBM-LES VOXELIZED MODEL
number_slider_2 = Slider(100, range=0..100)
dom = ConstructDomain(DomainStart=0, DomainEnd=number_slider_2)
dom_2 = ConstructDomain(DomainStart=0, DomainEnd=Slider(34, range=0..100))
box = DomainBox(Base=PlaneXY(500, 500, 0), X=dom, Y=dom, Z=dom_2)
number_slider_3 = Slider(10, range=0..100)
debrep = DeconstructBrep(Brep=box)  # -> Faces, Edges, Vertices
neg = Negative(Value=Slider(6, range=0..100))
item = ListItem(List=debrep.Faces, Index=4, Wrap=True)
offset = OffsetCurve(Curve=item, Distance=neg, Corners=1)
sdivide = DivideSurface(Surface=item, UCount=number_slider_3, VCount=number_slider_3)  # -> Points, Normals, Parameters
incurve = PointInCurve(Point=flatten(sdivide.Points), Curve=offset)  # -> Relationship, Point
cull = CullPattern(List=incurve.Point, CullPattern=incurve.Relationship)
voxmsh = VoxelMesh(
    Points=cull,
    Plane=PlaneXY(0, 0, 0),
    SizeX=Slider(5, range=0..10),
    SizeY=Slider(5, range=0..10),
    SizeZ=Slider(4, range=0..100),
    Triangulate=False)
mesh = Mesh(box)
meshbooleansplit = MeshBooleanSplit(Mesh=mesh, Splite=voxmsh)
number_slider_4 = Slider(5, range=0..10)
dispatch = Dispatch(List=meshbooleansplit, DispatchPattern=[True, False])  # -> ListA, ListB
mesh_2 = Mesh(dispatch.ListA)
mesh_3 = Mesh(dispatch.ListB)
bool = Boolean(Toggle(True))
volume = Volume(Geometry=mesh_2)  # -> Volume, Centroid
vd = CrystallonV2VoxelizeDistance(
    geometry=mesh_2,
    plane=item,
    voxel_size_x=number_slider_4,
    voxel_size_y=number_slider_4,
    voxel_size_z=number_slider_4,
    fill_completely=bool)

sdivide_2 = DivideSurface(Surface=rectangle.Rectangle, UCount=10, VCount=10)  # -> Points, Normals, Parameters

number_slider_5 = Slider(30, range=0..100)
mplane = MeshPlane(Boundary=brep, WidthCount=number_slider_5, HeightCount=number_slider_5)  # -> Mesh, Area
demesh = DeconstructMesh(Mesh=mplane.Mesh)  # -> Vertices, Faces, Colours, Normals
pt = Point(demesh.Vertices)

area = Area(Geometry=brep)  # -> Area, Centroid
circle = CircleCNR(Center=area.Centroid, Normal=Vector(0, 0, 1), Radius=Slider(51, range=0..100))
bbox = BoundingBox(Content=circle, Plane=PlaneXY(0, 0, 0))  # -> Box, Box_2
brep_2 = Brep(bbox.Box)
rad = Radians(Degrees=Slider(0, range=0..360))
scale_nu = ScaleNU(
    Geometry=brep_2,
    Plane=area.Centroid,
    ScaleX=Slider(-0.498, range=-10..10),
    ScaleY=Slider(-0.646, range=-10..10),
    ScaleZ=1)  # -> Geometry, Transform
line = LineSDL(Start=area.Centroid, Direction=Vector(0, 0, 1), Length=Slider(10, range=0..10))
rotax = RotateAxis(Geometry=scale_nu.Geometry, Angle=rad, Axis=line)  # -> Geometry, Transform

number_slider_6 = Slider(2, range=0..10)  # disabled
number_slider_7 = Slider(2, range=0..10)  # disabled
number_slider_8 = Slider(2, range=0..10)  # disabled
voxmsh_2 = VoxelMesh(
    Points=demesh.Vertices,
    Plane=PlaneXY(0, 0, 0),
    SizeX=number_slider_6,
    SizeY=number_slider_7,
    SizeZ=number_slider_8,
    Triangulate=False)  # -> graft(Voxelized); disabled
mesh_4 = Mesh(voxmsh_2)  # disabled
bbox_2 = BoundingBox(Content=mesh_4, Plane=PlaneXY(0, 0, 0), UnionBox=True)  # -> Box, Box_2; disabled
number_slider_9 = Slider(5.54, range=0..10)  # disabled
scale_nu_2 = ScaleNU(Geometry=bbox_2.Box_2, Plane=PlaneXY(0, 0, 0), ScaleX=1, ScaleY=1, ScaleZ=number_slider_9)  # -> Geometry, Transform; disabled
mesh_5 = Mesh(scale_nu_2.Geometry)  # disabled
msplit = MeshSplit(Mesh=mesh_5, Splitters=mesh_4)  # disabled
mjoin = MeshJoin(Meshes=msplit)  # disabled

incurve_2 = PointInCurve(Point=pt, Curve=rotax.Geometry)  # -> Relationship, Point
brep_3 = Brep(rotax.Geometry)
cull_2 = CullPattern(List=incurve_2.Point, CullPattern=incurve_2.Relationship)
debrep_2 = DeconstructBrep(Brep=brep_3)  # -> Faces, Edges, Vertices
difference = SetDifference(SetA=pt, SetB=cull_2)
divide = DivideCurve(Curve=debrep_2.Edges, Count=Slider(10, range=0..100), Kinks=True)  # -> flatten(Points), Tangents, Parameters

area_2 = Area(Geometry=rotax.Geometry)  # -> Area, Centroid
merge = Merge(Data1=cull_2, Data2=divide.Points)  # -> flatten(Result)
scale = Scale(Geometry=rotax.Geometry, Center=area_2.Centroid, Factor=Slider(0.95, range=0..1))  # -> Geometry, Transform
triremesh = TriRemesh(
    Geometry=scale.Geometry,
    Sharp=True,
    Features=merge,
    Length=Slider(4.3, range=0..10),
    Iterations=Slider(100, range=0..100))  # -> Triangulation, Dual, Creases
mesh_6 = Mesh(triremesh.Triangulation)
medges = MeshEdges(Mesh=mesh_6)  # -> NakedEdges, InteriorEdges, NonManifoldEdges

srf = Surface(rotax.Geometry)
offsets = OffsetOnSrf(Curve=flatten(rotax.Geometry), Distance=Slider(1.57, range=0..10), Surface=srf)  # -> flatten(Curve)
incurve_3 = PointInCurve(Point=pt, Curve=offsets)  # -> Relationship, Point
cull_3 = CullPattern(List=incurve_3.Point, CullPattern=incurve_3.Relationship)
merge_2 = Merge(Data1=cull_3, Data2=divide.Points)  # -> flatten(Result)
del = DelaunayMesh(Points=merge_2, Plane=PlaneXY(0, 30.1, 0))

preview = CustomPreview(
    Geometry=offsets,
    Material={diffuse=RGB(194, 10, 255), emission=RGB(58, 3, 76), shine=0.5, specular=RGB(255, 255, 255), transparency=0})
meshrepair = MeshRepair(Mesh=del)
m_facearea = MeshFaceArea(M=meshrepair)  # -> out, G, A, B; inputs M: Mesh
# ---------- m_facearea: VB usings ----------
Imports System.IO
Imports System.Linq
Imports System.Data
Imports System.Drawing
Imports System.Reflection
Imports System.Windows.Forms
Imports System.Xml
Imports System.Xml.Linq
Imports Microsoft.VisualBasic
Imports System.Runtime.InteropServices

Imports Rhino.DocObjects
Imports Rhino.Collections
Imports GH_IO
Imports GH_IO.Serialization
# ---------- m_facearea: VB ----------
    Component.Params.Input(0).Name = "Mesh"
    Component.Params.Input(0).Description = "Open or closed mesh"
    Component.Params.Input(1).Name = "Area Domain"
    Component.Params.Input(1).Description = "The domain that describes the range of areas to be tested against"

    Component.Params.Output(1).Name = "Preview Mesh"
    Component.Params.Output(1).Description = "A greyscale preview mesh reflecting the range of values"
    Component.Params.Output(2).Name = "Areas"
    Component.Params.Output(2).Description = "The area of each face of the mesh"
    Component.Params.Output(3).Name = "Pattern"
    Component.Params.Output(3).Description = "If the R input is used, the status of each sample point relative to the provided range (0 = Below, 1 = Within, 2 = Above)"

    If M IsNot Nothing Then
      Dim i,j,k,s As Integer

      Dim mf As Rhino.Geometry.Collections.MeshFaceList = Nothing
      Dim mfn As Rhino.Geometry.Collections.MeshFaceNormalList = Nothing
      Dim mv As Rhino.Geometry.Collections.MeshVertexList = Nothing
      Dim mtv As Rhino.Geometry.Collections.MeshTopologyVertexList = Nothing
      Dim mte As Rhino.Geometry.Collections.MeshTopologyEdgeList = Nothing
      Dim mn As Rhino.Geometry.Collections.MeshVertexNormalList = Nothing
      Dim mc As Rhino.Geometry.Collections.MeshVertexColorList = Nothing

      mf = m.Faces
      mfn = m.FaceNormals
      mv = m.Vertices
      mtv = m.TopologyVertices
      mte = m.TopologyEdges
      mn = m.Normals
      mc = m.VertexColors

      Dim arrArea As New list(Of Double)
      Dim oc As New list(Of color)
      Dim tv,farea,Tmin,Tmax As Double
      Dim arrPat As New list(Of Integer)

      Dim mfo As New list(Of MeshFace)
      Dim mvo As New list(Of point3d)

      For i = 0 To mf.count() - 1 Step 1
        s = mvo.count()
        Dim tm As New mesh
        Dim tmf As Rhino.Geometry.Collections.MeshFaceList = Nothing
        tmf = tm.Faces()
        tmf.AddFace(mf.item(i))
        tm.Vertices.AddVertices(mv)

        farea = Rhino.Geometry.AreaMassProperties.Compute(tm).Area
        arrArea.add(farea)

        If mf.item(i).isquad() Then
          mvo.add(mv.item(mf.item(i).A))
          mvo.add(mv.item(mf.item(i).B))
          mvo.add(mv.item(mf.item(i).C))
          mvo.add(mv.item(mf.item(i).D))
          mfo.add(New meshface(s, s + 1, s + 2, s + 3))
          k = 4
        Else
          mvo.add(mv.item(mf.item(i).A))
          mvo.add(mv.item(mf.item(i).B))
          mvo.add(mv.item(mf.item(i).C))
          mfo.add(New meshface(s, s + 1, s + 2))
          k = 3
        End If

        If i = 0 Then Tmin = farea Else If farea < Tmin Then Tmin = farea
        If farea > Tmax Then Tmax = farea
      Next

      If R = Nothing Then
        R.t0 = Tmin
        R.t1 = Tmax
      End If

      For i = 0 To mf.count() - 1 Step 1
        If mf.item(i).isquad() Then k = 4 Else k = 3

        If arrArea.item(i) < R.T0 Then
          For j = 0 To k - 1 Step 1
            oc.add(color.FromArgb(0, 0, 255))
          Next
          arrPat.add(0)
        ElseIf ((arrArea.item(i) > R.T1) Or ((r.t0 = 0) And (r.t1 = 0))) Then
          For j = 0 To k - 1 Step 1
            oc.add(color.FromArgb(255, 0, 0))
          Next
          arrPat.add(2)
        Else
          For j = 0 To k - 1 Step 1
            tv = math.Floor((arrArea.item(i) - R.T0) / (R.t1 - R.t0) * 255)
            oc.add(color.FromArgb(tv, tv, tv))
          Next
          arrPat.add(1)
        End If
      Next
      Dim mo As New mesh
      mo.vertices.AddVertices(mvo.toarray())
      mo.Faces.AddFaces(mfo.toarray())
      mo.VertexColors.AppendColors(oc.toarray())

      G = mo
      A = arrArea
      B = arrPat
    End If
# ---------- end m_facearea ----------
panel = Panel(m_facearea.A)
demesh_2 = DeconstructMesh(Mesh=meshrepair)  # -> Vertices, Faces, Colours, Normals
pt_2 = Point(demesh_2.Vertices)
listdexs = ListIndices(List=panel)
angledimmesh = AngularDimensionsMesh(Mesh=meshrepair, Text="{0:0.0}°", Size=0.15, LengthFactor=0.5)
mshstats = MeshStatistics(Mesh=meshrepair)  # -> VertexCount, FaceCount, QuadFaceCount, TriangleFaceCount, ColorCount, PieceCount

medges_2 = MeshEdges(Mesh=meshrepair)  # -> NakedEdges, InteriorEdges, NonManifoldEdges
mesh_points_txt = Panel(pt_2)
path = FilePath(mesh_points_txt)

face = MeshFace(demesh_2.Faces)
line_2 = Line(medges_2.NakedEdges)
line_3 = Line(medges_2.InteriorEdges)
concat = Concatenate(FragmentA=listdexs, FragmentB=",", FragmentC=face, FragmentD=",", FragmentE=panel)
merge_3 = Merge(Data1=line_2, Data2=line_3)
panel_2 = Panel(merge_3)

dom_3 = ConstructDomain(DomainStart=1, DomainEnd=100)
graph = GraphMapper(dom_3, x0=0, x1=100, y0=0, y1=10, container_name="Sine", Equation_px=[0, 0.789855063], Equation_py=[0, 0.7536231875])
jitter = Jitter(List=cull_3, Jitter=1, Seed=Slider(55, range=16..100))  # -> Values, Indices
lng = ListLength(List=jitter.Indices)
range = Range(Domain=graph, Steps=lng)
Z = UnitZ(Factor=range)
move = Move(Geometry=jitter.Values, Motion=Z)  # -> Geometry, Transform
del_2 = DelaunayMesh(Points=move.Geometry, Plane=PlaneXY(0, 0, 0))
medges_3 = MeshEdges(Mesh=del_2)  # -> NakedEdges, InteriorEdges, NonManifoldEdges

rdlines = RemoveDuplicateLinesKaramba3D(Line=merge_3, LimitDistance=0.005)  # -> OutLine, Info, Indexes
listdexs_2 = ListIndices(List=rdlines.OutLine)
index_mesh_face_and_area_xyz = Panel(concat)
end = EndPoints(Curve=merge_3)  # -> Start, End
pdecon = Deconstruct(Point=end.End)  # -> XComponent, YComponent, ZComponent
pdecon_2 = Deconstruct(Point=end.Start)  # -> XComponent, YComponent, ZComponent
concat_2 = Concatenate(
    FragmentO=listdexs_2,
    FragmentN=",",
    FragmentH="{",
    FragmentA=pdecon_2.XComponent,
    FragmentB=",",
    FragmentC=pdecon_2.YComponent,
    FragmentI="}",
    FragmentG=",",
    FragmentJ="{",
    FragmentD=pdecon.XComponent,
    FragmentE=",",
    FragmentF=pdecon.YComponent,
    FragmentK="}",
    FragmentL=",",
    FragmentM=rdlines.OutLine)
indexed_lattice_with_end_points = Panel(concat_2)

# ==== cluster CrystallonV2VoxelizeDistance: Fill a volume with equal sized voxels

voxel_size_x = ClusterInput()  # Voxel size int the X direction
voxel_size_y = ClusterInput()  # Voxel size int the Y direction
voxel_size_z = ClusterInput()  # Voxel size int the Z direction
plane = ClusterInput()  # Base plane for voxels
geometry = ClusterInput()  # Geometry to voxelize
fill_completely = ClusterInput()  # If true, Voxels will fill entire volume. If false, only Voxels with their centroid within the volume will be kept.
mesh = Mesh(geometry)
pln = Plane(plane)
num = Number(voxel_size_x)
num_2 = Number(voxel_size_y)
num_3 = Number(voxel_size_z)
bool = Boolean(fill_completely)
bbox = BoundingBox(Content=mesh, Plane=pln)  # -> Box, Box_2
edges = BrepEdges(Brep=bbox.Box)  # -> Naked, Interior, NonManifold
item = ListItem(List=edges.Interior, Index="8", Wrap=True)
item_2 = ListItem(List=edges.Interior, Index="1", Wrap=True)
# CRYSTALLON V2.0 -- Lattice structure tools for Grasshopper3D
# 
# Copyright (C) 2019  Aaron Porterfield
# 
# www.fequalsf.com
# info@fequalsf.com
# 
#     This program is free software: you can redistribute it and/or modify
#     it under the terms of the GNU General Public License as published by
#     the Free Software Foundation, either version 3 of the License, or any later version.
# 
#     This program is distributed in the hope that it will be useful,
#     but WITHOUT ANY WARRANTY; without even the implied warranty of
#     MERCHANTABILITY or FITNESS FOR A PARTICULAR PURPOSE.  See the
#     GNU General Public License for more details.
# 
#     You should have received a copy of the GNU General Public License
#     along with this program.  If not, see <http://www.gnu.org/licenses/>.
item_3 = ListItem(List=edges.Interior, Index="0", Wrap=True)
divlength = DivideLength(Curve=reparameterize(item_2), Length=num_2)  # -> Points, Tangents, Parameters
divlength_2 = DivideLength(Curve=reparameterize(item_3), Length=num)  # -> Points, Tangents, Parameters
divlength_3 = DivideLength(Curve=reparameterize(item), Length=num_3)  # -> Points, Tangents, Parameters
reldif = RelativeDifferences(Values=divlength.Parameters)
reldif_2 = RelativeDifferences(Values=divlength_2.Parameters)
reldif_3 = RelativeDifferences(Values=divlength_3.Parameters)
item_4 = ListItem(List=reverse(divlength.Parameters), Index=0, Wrap=True)
item_5 = ListItem(List=reverse(reldif), Index=0, Wrap=True)
item_6 = ListItem(List=reverse(divlength_2.Parameters), Index=0, Wrap=True)
item_7 = ListItem(List=reverse(reldif_2), Index=0, Wrap=True)
item_8 = ListItem(List=reverse(divlength_3.Parameters), Index=0, Wrap=True)
item_9 = ListItem(List=reverse(reldif_3), Index=0, Wrap=True)
addition = Addition(A=item_5, B=item_4)
addition_2 = Addition(A=item_7, B=item_6)
addition_3 = Addition(A=item_9, B=item_8)
merge = Merge(Data1=divlength.Parameters, Data2=addition)
merge_2 = Merge(Data1=divlength_2.Parameters, Data2=addition_2)
merge_3 = Merge(Data1=divlength_3.Parameters, Data2=addition_3)
crossref = CrossReference(ListA=merge, ListB=merge_3, CrossMode=1)  # -> ListA, ListB
box = EvaluateBox(Box=bbox.Box, UParameter=graft(merge_2), VParameter=crossref.ListA, WParameter=crossref.ListB)  # -> Plane, Point, Include
panel = Panel("Voxelize")
division = Division(A=num_3, B="2")
division_2 = Division(A=num_2, B="2")
division_3 = Division(A=num, B="2")
neg = Negative(Value=division)
neg_2 = Negative(Value=division_2)
neg_3 = Negative(Value=division_3)
dom = ConstructDomain(DomainStart=neg, DomainEnd=division)
dom_2 = ConstructDomain(DomainStart=neg_2, DomainEnd=division_2)
dom_3 = ConstructDomain(DomainStart=neg_3, DomainEnd=division_3)
crossref_2 = CrossReference(ListA=dom_2, ListB=dom, CrossMode=1)  # -> ListA, ListB
box_2 = DomainBox(Base=simplify(box.Plane), X=graft(dom_3), Y=crossref_2.ListA, Z=crossref_2.ListB)
minc = MeshInclusion(Mesh=mesh, Point=box.Plane, Strict=False)
sort = SortList(Keys=[num, num_2, num_3])  # -> Keys, ValuesA
cull = CullPattern(List=box_2, CullPattern=minc)
meshcp = MeshClosestPoint(Point=box.Plane, Mesh=mesh)  # -> Point, Index, Parameter
dist = Distance(PointA=box.Plane, PointB=meshcp.Point)
expression = Expression(a=sort.Keys, d=dist, Expression="if(d<sqrt(2*(a/2)^2),True,False)")
cull_2 = CullPattern(List=box_2, CullPattern=expression)
cull_3 = CullPattern(List=cull_2, CullPattern=bool)
merge_4 = Merge(Data1=cull, Data2=cull_3)
voxels = ClusterOutput(merge_4)  # Voxels to be filled with unit cells
